% Simulink data dictionary motor_parameters.sldd

currt_width = Simulink.Parameter(200, DataType="single")
Ubus = Simulink.Parameter(12, DataType="single")
Ibus = Simulink.Parameter(5, DataType="single")

PID_KpKi = Simulink.Bus()
  Kp: single
  Ki: single
  UpperLimit: single
  DownLimit: single

Speed_KpKi = Simulink.Parameter([0.0144 0.0389 3 -3], DataType="Bus: PID_KpKi")
R = Simulink.Parameter(0.083, DataType="single")
PLL_P = Simulink.Parameter(100, DataType="single")
PLL_I = Simulink.Parameter(50, DataType="single")
theat_Extern = Simulink.Signal(DataType="single")
id_ExternRef = Simulink.Signal(DataType="single")
OPL_time = Simulink.Parameter(3)
Ts = 0.0001
Pn = Simulink.Parameter(7, DataType="single")
Rs = Simulink.Parameter(0.112, DataType="single")
Ls = Simulink.Parameter(2.235e-5, DataType="single")
Flux = Simulink.Parameter(0.00103001, DataType="single")
Ld = Simulink.Parameter(2.235e-5, DataType="single")
Lq = Simulink.Parameter(2.567e-5, DataType="single")
smo_l = Simulink.Parameter(0.1, DataType="single")
smo_m = Simulink.Parameter(0.001, DataType="single")
i_alpha = Simulink.Signal(DataType="single")
i_beta = Simulink.Signal(DataType="single")
iq = Simulink.Signal(DataType="single")
id = Simulink.Signal(DataType="single")
ud = Simulink.Signal(DataType="single")
uq = Simulink.Signal(DataType="single")
u_alpha = Simulink.Signal(DataType="single")
u_beta = Simulink.Signal(DataType="single")