% Simulink data dictionary motor_parameters.sldd

Ubus = Simulink.Parameter(12, DataType="single")
Ibus = Simulink.Parameter(5, DataType="single")
Pn = Simulink.Parameter(7, DataType="single")
u_alpha = Simulink.Signal(StorageClass="Struct", StructName="foc", DataType="single")
u_beta = Simulink.Signal(StorageClass="Struct", StructName="foc", DataType="single")
iq = Simulink.Signal(StorageClass="Struct", StructName="foc", DataType="single")
id = Simulink.Signal(StorageClass="Struct", StructName="foc", DataType="single")
i_alpha = Simulink.Signal(StorageClass="Struct", StructName="foc", DataType="single")
i_beta = Simulink.Signal(StorageClass="Struct", StructName="foc", DataType="single")
ud = Simulink.Signal(StorageClass="Struct", StructName="foc", DataType="single")
uq = Simulink.Signal(StorageClass="Struct", StructName="foc", DataType="single")
theta_real = Simulink.Signal(StorageClass="Struct", StructName="foc", DataType="single")
Rs = Simulink.Parameter(0.112, StorageClass="Struct", StructName="motor", DataType="single")
Flux = Simulink.Parameter(0.00103001, StorageClass="Struct", StructName="motor", DataType="single")
Ld = Simulink.Parameter(2.235e-5, StorageClass="Struct", StructName="motor", DataType="single")
Lq = Simulink.Parameter(2.567e-5, StorageClass="Struct", StructName="motor", DataType="single")
spd_fdbk = Simulink.Signal(StorageClass="Struct", StructName="foc", DataType="single")
spd_ref = Simulink.Signal(StorageClass="Struct", StructName="foc", DataType="single")
theta_cos = Simulink.Signal(StorageClass="Struct", StructName="observer_flux", DataType="single")
theta_sin = Simulink.Signal(StorageClass="Struct", StructName="observer_flux", DataType="single")
Ts = 0.0001
flux_theta = Simulink.Signal(StorageClass="Struct", StructName="foc")
Ls = Simulink.Parameter(2.235e-5, StorageClass="Struct", StructName="motor", DataType="single")