% Simulink data dictionary motor_parameters.sldd

currt_width = Simulink.Parameter(200, DataType="single")
Ubus = Simulink.Parameter(12, DataType="single")
Ibus = Simulink.Parameter(5, DataType="single")

PID_KpKi = Simulink.Bus()
  Kp: single
  Ki: single
  UpperLimit: single
  DownLimit: single

Speed_KpKi = Simulink.Parameter([0.0144 0.0389 3 -3], DataType="Bus: PID_KpKi")
R = Simulink.Parameter(0.083, DataType="single")
PLL_P = Simulink.Parameter(100, DataType="single")
PLL_I = Simulink.Parameter(50, DataType="single")
smo_l = Simulink.Parameter(0.1, DataType="single")
smo_m = Simulink.Parameter(0.001, DataType="single")
hfi_posit_sum = Simulink.Parameter([], DataType="single")
hfi_negat_sum = Simulink.Parameter([], DataType="single")
Pn = Simulink.Parameter(7, DataType="single")
hfi_theta = Simulink.Signal(StorageClass="ExportedGlobal", DataType="single")
ns_single = Simulink.Signal(StorageClass="ExportedGlobal", DataType="single")
OPL_time = Simulink.Parameter(2)
id_ref = Simulink.Signal(StorageClass="Struct", StructName="foc", DataType="single")
iq_ref = Simulink.Signal(StorageClass="Struct", StructName="foc", DataType="single")
u_alpha = Simulink.Signal(StorageClass="Struct", StructName="foc", DataType="single")
u_beta = Simulink.Signal(StorageClass="Struct", StructName="foc", DataType="single")
iq = Simulink.Signal(StorageClass="Struct", StructName="foc", DataType="single")
id = Simulink.Signal(StorageClass="Struct", StructName="foc", DataType="single")
i_alpha = Simulink.Signal(StorageClass="Struct", StructName="foc", DataType="single")
i_beta = Simulink.Signal(StorageClass="Struct", StructName="foc", DataType="single")
ud = Simulink.Signal(StorageClass="Struct", StructName="foc", DataType="single")
uq = Simulink.Signal(StorageClass="Struct", StructName="foc", DataType="single")
theta_real = Simulink.Signal(StorageClass="Struct", StructName="foc", DataType="single")
Rs = Simulink.Parameter(0.112, StorageClass="Struct", StructName="motor", DataType="single")
Ls = Simulink.Parameter(2.235e-5, StorageClass="Struct", StructName="motor", DataType="single")
Flux = Simulink.Parameter(0.00103001, StorageClass="Struct", StructName="motor", DataType="single")
Ld = Simulink.Parameter(2.235e-5, StorageClass="Struct", StructName="motor", DataType="single")
Lq = Simulink.Parameter(2.567e-5, StorageClass="Struct", StructName="motor", DataType="single")
Gamma = Simulink.Parameter(800000, DataType="single")
spd_fdbk = Simulink.Signal(StorageClass="Struct", StructName="foc", DataType="single")
spd_ref = Simulink.Signal(StorageClass="Struct", StructName="foc", DataType="single")
theta_cos = Simulink.Signal(StorageClass="Struct", StructName="observer_flux", DataType="single")
theta_sin = Simulink.Signal(StorageClass="Struct", StructName="observer_flux", DataType="single")
Ts = 0.0001
flux_theta = Simulink.Signal(StorageClass="Struct", StructName="foc", DataType="single")